# Grasshopper definition PRC_SimplePath2.gh (Grasshopper 0.9.76)
# plug-ins: Python Interpreter, KUKA|prc - parametric robot control

panel = Panel("""PRC simple path using Kuka KR20
Ming Tang""")
crv = Curve(<curve referenced from the Rhino model>)
exporthydra = Hydra_ExportFile(fileName="PRC simple path study", fileDescription=panel, fileTags="1", includeRhino=Toggle(True), export=Toggle(True))  # -> readMe; inputs fileDescription: list, changeLog: list, fileTags: list, includeRhino: Boolean, GHForThumb: Boolean, additionalImgs: list, export: Boolean; plug-in component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

# ---- group: Divide into Points
divide = DivideCurve(Curve=crv, Count=Slider(31, range=0..100), Kinks=False)  # -> Points, Tangents, Parameters

# ---- group: Points
pt = Point(divide.Points)

# ---- group: One plane at each point
xy = XYPlane(Origin=pt)

# ----
pt_2 = Point(Point(-366.8347172, 249.8187953, 0))

# ---- group: Orient so that they are aligned to the robot
orient_pln = KUKAPrcOrientPlane(Plane=xy, OrientPoint=pt_2)

# ---- group: Turn into LINear movement
lin_move = KUKAPrcLINearMovement(TargetAsPlane=orient_pln, extaxenabled=False, impedancemode=False, interpolation="C_DIS")

# ---- group: Simplest possible toolpath > lacking control over approach etc.
divide_2 = DivideCurve(Curve=crv, Count=10, Kinks=False)  # -> Points, Tangents, Parameters
xy_2 = XYPlane(Origin=divide_2.Points)
lin_move_2 = KUKAPrcLINearMovement(TargetAsPlane=xy_2, extaxenabled=False, impedancemode=False, interpolation="C_DIS")

# ---- group: Add 20mm safety distance at start and end
tool_axis_offset = KUKAPrcToolAxisOffset(KUKAPrcCommand=lin_move, OffsetAlongToolaxis="20", OffsetStart=True, OffsetEnd=True)

# ---- group: Set same Tool-ID as calibrated at the robot!
kress_spindle = Kress1050Spindle(ToolLength=35, ToolDiameter=6, ToolNumber=6, GenerateTool=True)

# ----
play = KUKAPrcPlay(Loop=False, Reset=False, savedtime=2.738433666)
kress_spindle_2 = Kress1050Spindle(ToolLength=35, ToolDiameter=6, ToolNumber=6, GenerateTool=True)
kuka_kr6_16_20 = KUKAKR61620(highresactive=False, infiniterot=False)
fipa_gripper = FIPATC120x230VacuumGripper(ToolNumber=6)
elte_spindle = ElteSpindle(ToolLength=100, ToolDiameter=10, ToolNumber=6, GenerateTool=True)
custom_tool_via_gh = CustomToolGH(frameinput=False)
kress_spindle_3 = Kress1050Spindle(ToolLength=35, ToolDiameter=6, ToolNumber=6, GenerateTool=True)
kuka_spindle = KUKAHSDSpindle(ToolLength=100, ToolDiameter=10, ToolNumber=6, GenerateTool=True)

# ---- group: Set same base number in Settings, as calibrated at the robot
kuka_prc = KUKAPrcCORE(
    SimulationSlider=Slider(0.737, range=0..1),
    KUKAPrcCommands=tool_axis_offset,
    KUKAPrcTool=kress_spindle_3,
    KUKAPrcRobot=kuka_kr6_16_20,
    acc_cp=nan,
    acc_ptp=-1,
    basea=0,
    baseb=0,
    basec=0,
    baseindex=4,
    basex=450,
    basey=-200,
    basez=200,
    camrobformatting="""&ACCESS RVP
&REL 1
&PARAM TEMPLATE = C:\KRC\Roboter\Template\vorgabe
&PARAM EDITMASK = *
[PROJECTNAME]

[SPLITDEFS]

;FOLD INI
;FOLD BASISTECH INI
GLOBAL INTERRUPT DECL 3 WHEN $STOPMESS==TRUE DO IR_STOPM ( )
INTERRUPT ON 3
BAS (#INITMOV,0 )
;ENDFOLD (BASISTECH INI)
;ENDFOLD (INI)

[STARTAXPOS]

[SETPARAMETERS]

[COMMANDS]

END""",
    camrobon=False,
    checkallcolls=False,
    enda01=5,
    enda02=-90,
    enda03=100,
    enda04=5,
    enda05=10,
    enda06=-5,
    ende01=0,
    ende02=0,
    ende03=0,
    ende04=0,
    endindex=0,
    haltatend=False,
    hardcode=False,
    hash=2711,
    initialstatus="110",
    int_advance=3,
    int_cdis=nan,
    int_cori=nan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)  # -> RobotGeometry, AnalysisOutput

# ----
custom_tool = CustomToolForKUKAPrc(toolid=6, toolvala=0, toolvalb=0, toolvalc=0, toolvalx=0, toolvaly=0, toolvalz=0, valuesset=False)
